# Grasshopper definition map.gh (Grasshopper 1.0.7)
# plug-ins: ClipperComponents, Bifocals, ShapeDiverForGrasshopper

sddp = ShapeDiverDocumentPayload({AbsoluteTolerance=0, AngleTolerance=0, DistanceDisplayPrecision=0, GltfVersion="Gltf2", InputGroups="{}", OutputGroups="{}", RelativeTolerance=0, UnitSystem=0, VersionCreated="1.13.1.0", VersionSaved="1.13.1.0"})

# ---- group: transport data
file_path = FilePath("C:\Uni\2024\Term 2\CODE2132\sabri-web-page\web-page\assets\transport_data.geojson")

# ---- group: highway data
file_path_2 = FilePath("C:\Uni\2024\Term 2\CODE2132\sabri-web-page\web-page\assets\highway_data.geojson")

# ---- group: building data
file_path_3 = FilePath("C:\Uni\2024\Term 2\CODE2132\sabri-web-page\web-page\assets\building_data.geojson")

# ----
file_path_4 = FilePath("C:\Uni\2024\Term 2\CODE2132\sabri-web-page\web-page\assets\point.json")
read_file = ReadFile(File=file_path_2, PerLineParse=True)
read_file_2 = ReadFile(File=file_path_4, PerLineParse=True)
read_file_3 = ReadFile(File=file_path_3, PerLineParse=True)
read_file_4 = ReadFile(File=file_path, PerLineParse=True)
panel = Panel(read_file_2)
replace_text = ReplaceText(Text=read_file_3, Find=" ", RecursiveReplace=False)
replace_text_2 = ReplaceText(Text=read_file, Find=" ", RecursiveReplace=False)
construct_point = ConstructPoint(XCoordinate=0, YCoordinate=0, ZCoordinate=0)
replace_text_3 = ReplaceText(Text=read_file_4, Find=" ", RecursiveReplace=False)
text_join = TextJoin(Text=replace_text)
panel_2 = Panel("""-1
0""")
text_join_2 = TextJoin(Text=replace_text_2)
text_join_3 = TextJoin(Text=replace_text_3)
cull_index = CullIndex(List=panel, Indices=panel_2, Wrap=True)
ghpython_script = GhPythonScript(geojson_data=text_join_2, origin_pt=construct_point)  # -> out, a; inputs origin_pt: Point3d
# ---------- ghpython_script: Python ----------
import rhinoscriptsyntax as rs
import json
import math
import System
from Grasshopper import DataTree
from Grasshopper.Kernel.Data import GH_Path

def latlon_to_meters(lat, lon, origin_lat, origin_lon):
    # Constants for GDA94 / MGA zone 56 (EPSG:28356)
    # Central meridian (Longitude) for zone 56
    cm = 153.0
    k0 = 0.9996
    false_easting = 500000.0
    false_northing = 10000000.0 if lat < 0 else 0.0

    # Ellipsoid parameters (GRS80 / WGS84)
    a = 6378137.0
    f = 1 / 298.257222101
    b = a * (1 - f)
    e = math.sqrt(1 - (b / a) ** 2)
    e2 = e ** 2 / (1 - e ** 2)

    lat_rad = math.radians(lat)
    lon_rad = math.radians(lon)
    cm_rad = math.radians(cm)

    nu = a / math.sqrt(1 - e ** 2 * math.sin(lat_rad) ** 2)
    p = lon_rad - cm_rad

    A = (lon_rad - cm_rad) * math.cos(lat_rad)
    T = math.tan(lat_rad) ** 2
    C = e2 * math.cos(lat_rad) ** 2
    M = a * ((1 - e ** 2 / 4 - 3 * e ** 4 / 64 - 5 * e ** 6 / 256) * lat_rad
             - (3 * e ** 2 / 8 + 3 * e ** 4 / 32 + 45 * e ** 6 / 1024) * math.sin(2 * lat_rad)
             + (15 * e ** 4 / 256 + 45 * e ** 6 / 1024) * math.sin(4 * lat_rad)
             - (35 * e ** 6 / 3072) * math.sin(6 * lat_rad))

    x = false_easting + k0 * nu * (A + (1 - T + C) * A ** 3 / 6 + (5 - 18 * T + T ** 2 + 72 * C - 58 * e2) * A ** 5 / 120)
    y = false_northing + k0 * (M + nu * math.tan(lat_rad) * (A ** 2 / 2 + (5 - T + 9 * C + 4 * C ** 2) * A ** 4 / 24
                         + (61 - 58 * T + T ** 2 + 600 * C - 330 * e2) * A ** 6 / 720))

    return x, y

def geojson_to_rhino_points(geojson_data, origin_pt):
    origin_lat = origin_pt.Y  # Assuming origin_pt.Y is latitude
    origin_lon = origin_pt.X  # Assuming origin_pt.X is longitude
    
    geojson = json.loads(geojson_data)
    features = geojson.get('features', [])
    data_tree = DataTree[System.Object]()
    
    for i, feature in enumerate(features):
        geometry = feature.get('geometry', {})
        geom_type = geometry.get('type', '')
        coordinates = geometry.get('coordinates', [])
        
        path = GH_Path(i)
        
        if geom_type == 'Point':
            x, y = latlon_to_meters(coordinates[1], coordinates[0], origin_lat, origin_lon)
            pt = rs.CreatePoint(x, y, 0)
            data_tree.Add(pt, path)
            
        elif geom_type == 'LineString':
            for coord in coordinates:
                x, y = latlon_to_meters(coord[1], coord[0], origin_lat, origin_lon)
                pt = rs.CreatePoint(x, y, 0)
                data_tree.Add(pt, path)
            
        elif geom_type == 'Polygon':
            for polygon in coordinates:
                for coord in polygon:
                    x, y = latlon_to_meters(coord[1], coord[0], origin_lat, origin_lon)
                    pt = rs.CreatePoint(x, y, 0)
                    data_tree.Add(pt, path)
    
    return data_tree

# Inputs (from Grasshopper)
geojson_data_string = geojson_data  # GeoJSON data as string
origin_pt = origin_pt  # Rhino origin point (Point3d)

# Convert GeoJSON points to Rhino points
rhino_points = geojson_to_rhino_points(geojson_data_string, origin_pt)

# Output the results (in Grasshopper)
a = rhino_points
# ---------- end ghpython_script ----------
ghpython_script_2 = GhPythonScript(geojson_data=text_join, origin_pt=construct_point)  # -> out, a; inputs origin_pt: Point3d; same code as ghpython_script
ghpython_script_3 = GhPythonScript(geojson_data=text_join_3, origin_pt=construct_point)  # -> out, a; inputs origin_pt: Point3d; same code as ghpython_script
text_split = TextSplit(Text=cull_index, Separators=":")
polyline = PolyLine(Vertices=ghpython_script_2.a, Closed=False)
polyline_2 = PolyLine(Vertices=ghpython_script.a, Closed=False)
point = Point(ghpython_script_3.a)
text_split_2 = TextSplit(Text=text_split, Separators="\"")  # -> simplify(Result)
explode = Explode(Curve=[polyline_2, polyline], Recursive=True)  # -> Segments, flatten(Vertices)
trim_tree = TrimTree(Tree=text_split_2, Depth=1)
merge = Merge(Data1=explode.Vertices, Data2=flatten(point))
list_item = ListItem(List=trim_tree, Index="4", Wrap=True)
average = Average(Input=flatten(merge))
list_item_2 = ListItem(List=flatten(list_item), Index=0, Wrap=True)  # -> Item, Item1
vector_2pt = Vector2Pt(PointA=average, PointB=construct_point, Unitize=False)  # -> Vector, Length
construct_point_2 = ConstructPoint(XCoordinate=list_item_2.Item, YCoordinate=list_item_2.Item1, ZCoordinate=0)
move = Move(Geometry=polyline_2, Motion=vector_2pt.Vector)  # -> Geometry, Transform
move_2 = Move(Geometry=polyline, Motion=vector_2pt.Vector)  # -> Geometry, Transform
move_3 = Move(Geometry=point, Motion=vector_2pt.Vector)  # -> Geometry, Transform
area = Area(Geometry=move_2.Geometry)  # -> Area, flatten(Centroid)
polyline_offset = PolylineOffset(
    Polylines=move_2.Geometry,
    Distance=Slider(5, range=0..10),
    Plane=Plane(origin=(0, 0, 0), x=(0, 0, 0), y=(0, 0, 0)),
    Tolerance=0.001,
    ClosedFillet=1,
    OpenFillet=1,
    Miter=2)  # -> Contour, Holes
geometry = Geometry(polyline_offset.Contour)
region_union = RegionUnion(Curves=flatten(geometry))
area_2 = Area(Geometry=region_union)  # -> Area, Centroid
bounding_box = BoundingBox(Content=region_union, Plane=PlaneXY(0, 0, 0))  # -> Box, Box_2
larger_than = LargerThan(FirstNumber=area_2.Area, SecondNumber=Slider(1482, range=0..10000))  # -> LargerThan, OrEqualTo
area_3 = Area(Geometry=bounding_box.Box)  # -> Area, Centroid
cull_pattern = CullPattern(List=region_union, CullPattern=larger_than.LargerThan)
sort_list = SortList(Keys=area_3.Area, ValuesValuesA=bounding_box.Box)  # -> Keys, ValuesValuesA
area_4 = Area(Geometry=cull_pattern)  # -> Area, Centroid
list_item_3 = ListItem(List=reverse(sort_list.ValuesValuesA), Index=0, Wrap=True)
smaller_than = SmallerThan(FirstNumber=area_4.Area, SecondNumber=Slider(18168, range=0..100000))  # -> SmallerThan, OrEqualTo
cull_pattern_2 = CullPattern(List=cull_pattern, CullPattern=smaller_than.SmallerThan)
point_in_curves = PointInCurves(Point=area.Centroid, Curves=graft(cull_pattern_2))  # -> Relationship, Index, Point
mass_addition = MassAddition(Input=point_in_curves.Relationship)  # -> Result, PartialResults
larger_than_2 = LargerThan(FirstNumber=mass_addition.Result, SecondNumber=0)  # -> simplify(LargerThan), OrEqualTo
cull_pattern_3 = CullPattern(List=simplify(graft(cull_pattern_2)), CullPattern=invert(larger_than_2.LargerThan))
polyline_offset_2 = PolylineOffset(
    Polylines=cull_pattern_3,
    Distance=Slider(5, range=0..10),
    Plane=Plane(origin=(0, 0, 0), x=(0, 0, 0), y=(0, 0, 0)),
    Tolerance=0.001,
    ClosedFillet=1,
    OpenFillet=1,
    Miter=2)  # -> Contour, Holes
boundary_surfaces = BoundarySurfaces(Edges=move_2.Geometry)
area_5 = Area(Geometry=boundary_surfaces)  # -> Area, Centroid
construct_point_3 = ConstructPoint(XCoordinate=0, YCoordinate=0, ZCoordinate=0)
distance = Distance(PointA=area_5.Centroid, PointB=construct_point_3)
construct_domain = ConstructDomain(DomainStart=Slider(7, range=0..100), DomainEnd=Slider(15, range=0..100))
bounds = Bounds(Numbers=flatten(distance))
remap_numbers = RemapNumbers(Value=distance, Source=bounds, Target=construct_domain)  # -> Mapped, Clipped
unit_z = UnitZ(Factor=remap_numbers.Mapped)
extrude = Extrude(Base=boundary_surfaces, Direction=unit_z)
